# Grasshopper definition Robots-Custom_Command.gh (Grasshopper 1.0.7)
# plug-ins: Robots

res = Slider(7, range=0..10)
proportion = Integer([105, 216, 250, 251, 234, 209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])

_2º = PowerOf2(Value=res)
remap = RemapNumbers(Value=proportion, Source=Domain(0, 255), Target=Domain(0, 1))  # -> Mapped, Clipped
subtraction = Subtraction(A=_2º, B="1")
round = Round(Number=remap.Mapped)  # -> Nearest, Floor, Ceiling
values_a = Integer(round.Nearest)
concat = Concatenate(FragmentA="SetGO GO_0,", FragmentB=values_a, FragmentC=";")
customcmd = CustomCommand(Name="Custom command", ABBCode=concat)
